# Grasshopper definition geometry_generation.ghx (Grasshopper 1.0.7)
# plug-ins: Kangaroo2 Components, Weaverbird, MeshEdit Components, Pufferfish, NGon

# 01 - Reciprocal Frame
number_slider = Slider(100, range=0..100)
# Additive
# 00 - Simple 2D Frame
number_slider_2 = Slider(0, range=0..10)
# 01 - spatial assembly with nodes
number_slider_3 = Slider(3.1, range=0..10)

# ---- group: monkey saddle
# Rotate Mesh edge according to average Normal
# And cut end parts - Rectangle Sections
python = GhPythonScript(u_count=number_slider, v_count=Slider(100, range=0..100), size=Slider(0.6, range=0..1))  # -> out, points; inputs u_count: Int32, v_count: Int32
# ---------- python: Python ----------
import Rhino.Geometry as rg

import math

def monkey_saddle(u_count, v_count, size):
    points = []
    for u in range(u_count):
        pts = []
        for v in range(v_count):
            x = size * (-1 + 2.0*u/(u_count-1))
            y = size * (-1 + 2.0*v/(v_count-1))
            z = size * (x**3 - 3*x*y**2)
            pts.append(rg.Point3d(x, y, z))
        points.append(pts)
    return points
    
points = monkey_saddle(u_count, v_count, size)
# ---------- end python ----------

# ----
number_slider_4 = Slider(0.03, range=0..0.1)
curve = Curve(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)
construct_point = ConstructPoint(XCoordinate=Slider(0.5, range=0..1), YCoordinate=Slider(1.25, range=0..10), ZCoordinate=0)
construct_point_2 = ConstructPoint(XCoordinate=Slider(0.4, range=0..1), YCoordinate=Slider(1.9, range=0..10), ZCoordinate=0)
construct_point_3 = ConstructPoint(XCoordinate=Slider(1.3, range=0..10), YCoordinate=Slider(2.1, range=0..10), ZCoordinate=0)
construct_point_4 = ConstructPoint(XCoordinate=Slider(1.3, range=0..10), YCoordinate=Slider(1.45, range=0..10), ZCoordinate=0)
scale = Scale(Geometry=curve, Center=Point(0, 0, 0), Factor=number_slider_3)  # -> Geometry, Transform
unit_x = UnitX(Factor=Slider(1.92, range=0..10))
python_2 = GhPythonScript(x=python.points)  # -> out, a
# ---------- python_2: Python ----------
a =x
# ---------- end python_2 ----------
point = Point([construct_point, construct_point_2, construct_point_3, construct_point_4])
pt = Point(python_2.a)
flip = FlipMatrix(Data=pt)
move = Move(Geometry=scale.Geometry, Motion=unit_x)  # -> Geometry, Transform
ghpython_script = GhPythonScript(points=point, dist=number_slider_4)  # -> out, new_curves; inputs points: list of Point3d
# ---------- ghpython_script: Python ----------
import Rhino.Geometry as rg

crv1 = rg.Curve.CreateInterpolatedCurve(points + [points[0]], 1)

crv2 = crv1.Offset( 0.5*(points[0]+points[2]), rg.Vector3d.ZAxis, dist, 0.01, rg.CurveOffsetCornerStyle.None )[0]

pol1 = crv1.ToPolyline()
pol2 = crv2.ToPolyline()

new_curves = []

for i in range(len(pol2)-1):
    temp = [ pol2[i], pol1[i], pol1[i+1], pol2[i+1], pol2[i] ]
    c = rg.Curve.CreateInterpolatedCurve(temp, 1)
    new_curves.append(c)
# ---------- end ghpython_script ----------
explode = Explode(Curve=ghpython_script.new_curves, Recursive=True)  # -> Segments, Vertices
item = ListItem(List=pt, Index=0, Wrap=True)  # -> Item1, Item
item_2 = ListItem(List=flip, Index=0, Wrap=True)  # -> Item1, Item
cull_index = CullIndex(List=explode.Vertices, Indices=Slider(0, range=0..100), Wrap=True)
loft = Loft(
    Curves=flatten([scale.Geometry, move.Geometry]),
    Options={Adjust=False, Closed=False, LoftEnds=0, LoftSimp=0, LoftType=0, Rebuild=10, Refit=0.01})
intcrv = Interpolate(Vertices=flatten(item.Item1), Degree=3, Periodic=False, KnotStyle=1)  # -> Curve, Length, Domain
intcrv_2 = Interpolate(Vertices=flatten(item.Item), Degree=3, Periodic=False, KnotStyle=1)  # -> Curve, Length, Domain
intcrv_3 = Interpolate(Vertices=flatten(item_2.Item1), Degree=3, Periodic=False, KnotStyle=1)  # -> Curve, Length, Domain
intcrv_4 = Interpolate(Vertices=flatten(item_2.Item), Degree=3, Periodic=False, KnotStyle=1)  # -> Curve, Length, Domain
construct_mesh = ConstructMesh(Vertices=cull_index, Faces={A=0, B=1, C=2, D=3})  # -> flatten(Mesh)
number_slider_5 = Slider(2, range=0..10)
brep = Brep(loft)
swp2 = Sweep2(Rail1=intcrv.Curve, Rail2=intcrv_2.Curve, Sections=[intcrv_3.Curve, intcrv_4.Curve], SameHeight=False)
offset_mesh = OffsetMesh(Mesh=construct_mesh, Distance=number_slider_4, BothSides=0, CreateSolid=True)  # -> flatten(Offset)
deconstruct_mesh = DeconstructMesh(Mesh=offset_mesh)  # -> Vertices, Faces, Colours, flatten(Normals)
list_item = ListItem(List=deconstruct_mesh.Normals, Index=0, Wrap=True)
populate_geometry = PopulateGeometry(Geometry=offset_mesh, Count=100, Seed=1)  # -> flatten(Population)
list_length = ListLength(List=populate_geometry)
triremesh = TriRemesh(Geometry=brep, Length=Slider(0.99, range=0..1), Iterations=Slider(1000, range=0..1000))  # -> Triangulation, Dual, Creases
repeat_data = RepeatData(Data=ColourSwatch(SwatchColor=RGB(171, 72, 72)), Length=list_length)
repeat_data_2 = RepeatData(Data=list_item, Length=list_length)
scale_nu = ScaleNU(Geometry=swp2, Plane=PlaneXY(0, 0, 0), ScaleX=number_slider_5, ScaleY=number_slider_5, ScaleZ=Slider(2, range=0..10))  # -> Geometry, Transform

mesh = Mesh(triremesh.Triangulation)
wboffset = WeaverbirdsOffsetMesh(MeshCurves=mesh, Distance=Slider(0.64, range=0..1), OffsetType=0)
faceb = FaceBoundaries(Mesh=wboffset)
faceb_2 = FaceBoundaries(Mesh=mesh)  # -> graft(Boundaries)
explode_2 = Explode(Curve=faceb, Recursive=True)  # -> Segments, Vertices
wbdual = WeaverbirdsDualGraph(MeshCurves=wboffset, DualMode=0)
disc = Discontinuity(Curve=faceb_2, Level=1)  # -> Points, Parameters
end = EndPoints(Curve=explode_2.Segments)  # -> Start, End
avr = Average(Input=end.Start)
medges = MeshEdges(Mesh=mesh)  # -> NakedEdges, InteriorEdges, NonManifoldEdges
ln = Line(StartPoint=disc.Points, EndPoint=avr)
explode_3 = Explode(Curve=wbdual, Recursive=True)  # -> Segments, Vertices

hexdivide = HexDivide(
    Surface=scale_nu.Geometry,
    U=Slider(7, range=0..10),
    V=Slider(5, range=0..10),
    Parameter=0.25,
    Boundary=0,
    Swap=True,
    Rebuild=9,
    Quadrangulate=False,
    Divisions=False,
    Explode=True)  # -> Mesh, DistA, DistB

# ---- group: export mesh to .ply
ghpython_script_2 = GhPythonScript(meshes=offset_mesh, idx=number_slider_2, folder_name="00_Additive", export=Toggle(True))  # -> out, a; inputs meshes: list of Mesh, export: Boolean
# ---------- ghpython_script_2: Python ----------
__author__ = "eleni"
__version__ = "2024.03.20"

import Rhino
import System
import scriptcontext
import sys
import os


HERE = ghenv.LocalScope.ghdoc.Path
FOLDER = os.path.abspath(os.path.join(HERE, '..', '..', folder_name + "/0" + idx))
filename = "0" + idx + '_mesh.ply'
filepath = os.path.join(FOLDER, filename)


#bake meshes to Rhino
new_attributes = Rhino.DocObjects.ObjectAttributes()

for mesh in meshes:  
    Rhino.RhinoDoc.ActiveDoc.Objects.AddMesh(mesh, new_attributes)

#export to .ply
    
write_options = Rhino.FileIO.FileWriteOptions()
write_options.WriteSelectedObjectsOnly = False

ply_options = Rhino.FileIO.FilePlyWriteOptions(write_options)
ply_options.UseSimpleDialog = True

if export:
    rc = Rhino.FileIO.FilePly.Write(filepath, Rhino.RhinoDoc.ActiveDoc, ply_options)
    if rc == Rhino.PlugIns.WriteFileResult.Success:
        print "Success, file saved:", filepath
    else:
        print "Error saving file:", filepath
    
    
#delete meshes from Rhino
objects = Rhino.RhinoDoc.ActiveDoc.Objects.FindByLayer("Default")
for obj in objects:
    Rhino.RhinoDoc.ActiveDoc.Objects.Remove(obj)
# ---------- end ghpython_script_2 ----------

# ---- group: export PCD to .ply
ghpython_script_3 = GhPythonScript(
    points=populate_geometry,
    colors=repeat_data,
    normals=repeat_data_2,
    idx=number_slider_2,
    folder_name="00_Additive",
    export=Toggle(True))  # -> out; inputs points: list of Point3d, colors: list, normals: list, export: Boolean
# ---------- ghpython_script_3: Python ----------
__author__ = "eleni"
__version__ = "2024.03.20"

import Rhino.Geometry as rg
import Rhino
import System
import scriptcontext
import sys
import os


HERE = ghenv.LocalScope.ghdoc.Path
FOLDER = os.path.abspath(os.path.join(HERE, '..', '..', folder_name + "/0" + idx))
filename = "0" + idx + '_pt.ply'
filepath = os.path.join(FOLDER, filename)


#bake meshes to Rhino
new_attributes = Rhino.DocObjects.ObjectAttributes()
pcd = rg.PointCloud()

for p,n,c in zip(points,normals,colors):
    pcd.Add(p,n,c)

Rhino.RhinoDoc.ActiveDoc.Objects.AddPointCloud(pcd, new_attributes)

#export to .ply
    
write_options = Rhino.FileIO.FileWriteOptions()
write_options.WriteSelectedObjectsOnly = False

ply_options = Rhino.FileIO.FilePlyWriteOptions(write_options)
ply_options.UseSimpleDialog = True

if export:
    rc = Rhino.FileIO.FilePly.Write(filepath, Rhino.RhinoDoc.ActiveDoc, ply_options)
    if rc == Rhino.PlugIns.WriteFileResult.Success:
        print "Success, file saved:", filepath
    else:
        print "Error saving file:", filepath
    
    
#delete meshes from Rhino
objects = Rhino.RhinoDoc.ActiveDoc.Objects.FindByLayer("Default")
for obj in objects:
    Rhino.RhinoDoc.ActiveDoc.Objects.Remove(obj)
# ---------- end ghpython_script_3 ----------

# ----
top = GetPolylines(Mesh=hexdivide.Mesh)
panel = Panel(ghpython_script_3)
panel_2 = Panel(ghpython_script_2.out)
fromp = FromPolylines(Curves=top, Min_Triangulation=False)
recipricalextend = RecipricalExtend(Mesh=fromp, Angle=Slider(0.24, range=0..1), Scale=1.4, NormalType=True, Height=1)  # -> graft(Axes), Faces, LineP, EndP, Nei
point_2 = Point(flatten([avr, disc.Points]))
deplane = DeconstructPlane(Plane=graft(recipricalextend.LineP))  # -> Origin, XAxis, YAxis, ZAxis
ext = ExtendCurve(Curve=recipricalextend.Axes, Type=0, Start=1, End=1)
number_slider_6 = Slider(0.033, range=0..0.1)
graft = GraftTree(Tree=recipricalextend.EndP, IncludeEmptyLists=True, IncludeNullItems=True)
end_2 = EndPoints(Curve=ext)  # -> Start, End
deplane_2 = DeconstructPlane(Plane=graft)  # -> Origin, XAxis, YAxis, ZAxis
pl = ConstructPlane(Origin=[end_2.Start, end_2.End], XAxis=deplane.YAxis, YAxis=deplane.ZAxis)
curve_2 = Curve(flatten([explode_3.Segments, ln]))
crv = Curve(flatten([ln, medges.InteriorEdges, medges.NakedEdges, explode_3.Segments]))
pline = PolyLine(Vertices=recipricalextend.EndP, Closed=False)
neg = Negative(Value=number_slider_6)
item_3 = ListItem(List=pl, Index=0, Wrap=True)  # -> Item, Item1
ghpython_script_4 = GhPythonScript(lines=curve_2)  # -> out, a; inputs lines: list of Curve
# ---------- ghpython_script_4: Python ----------
import Rhino.Geometry as rg

import Rhino.Collections.CurveList as curveList

lines = curveList(lines).ToArray()

a = rg.Mesh.CreateFromLines(lines, 3, 0.01)
# ---------- end ghpython_script_4 ----------
curvepoint = PointOnCurve(pline, parameter=0.5)
amp = Amplitude(Vector=deplane_2.ZAxis, Amplitude=[number_slider_6, neg])
dom = ConstructDomain(DomainStart=expr("-X", number_slider_6), DomainEnd=number_slider_6)
project = Project(Geometry=item_3.Item, Plane=item_3.Item1)  # -> Geometry, Transform
mesh_2 = Mesh(triremesh.Triangulation)
mesh_3 = Mesh(ghpython_script_4.a)
move_2 = Move(Geometry=graft(graft), Motion=amp)  # -> simplify(Geometry), Transform
dup = DuplicateData(Data=curvepoint, Number=2, Order=True)  # -> simplify(graft(Data))
mesh_edges = MeshEdges(Mesh=mesh_3)  # -> NakedEdges, InteriorEdges, NonManifoldEdges
mesh_edges_2 = MeshEdges(Mesh=mesh_2)  # -> NakedEdges, InteriorEdges, NonManifoldEdges
merge = Merge(Data1=project.Geometry, Data2=item_3.Item)
dist = Distance(PointA=dup, PointB=move_2.Geometry)
sort = SortList(Keys=dist, ValuesA=move_2.Geometry)  # -> Keys, ValuesA
rectangle = Rectangle(Plane=merge, XSize=dom, YSize=dom, Radius=0)  # -> Rectangle, Length
item_4 = ListItem(List=sort.ValuesA, Index=0, Wrap=True)
join_curves = JoinCurves(Curves=mesh_edges.NakedEdges, Preserve=False)
join_curves_2 = JoinCurves(Curves=mesh_edges_2.NakedEdges, Preserve=False)
trim = TrimTree(Tree=item_4, Depth=1)
item_5 = ListItem(List=trim, Index=0, Wrap=True)  # -> Item, Item1
project_2 = Project(Geometry=item_5.Item, Plane=item_5.Item1)  # -> Geometry, Transform
explode_4 = Explode(Curve=join_curves_2, Recursive=True)  # -> Segments, Vertices
explode_5 = Explode(Curve=join_curves, Recursive=True)  # -> Segments, Vertices
loft_2 = LoftPolylines(Curve0=rectangle.Rectangle, Fast=invert(True))
merge_2 = Merge(Data1=project_2.Geometry, Data2=item_5.Item)
list_to_shorten = Point(explode_5.Vertices)
use_to_filter = Point(explode_4.Vertices)
sec = MeshPlane(Mesh=loft_2, Plane=merge_2)
ghpython_script_5 = GhPythonScript(x=list_to_shorten, y=use_to_filter)  # -> out, polylines; inputs x: list of Point3d, y: list of Point3d
# ---------- ghpython_script_5: Python ----------
import Rhino.Geometry as rg
top = []
base = []
polylines = []

for p in x:
    if p not in y:
        top.append(p)
    else:
        base.append(p)
        
        
a = top
b = base

for i, (p1,p2) in enumerate(zip(top,base)):
    crv = rg.Curve.CreateInterpolatedCurve( [p1,p2,base[i-1], p1], 1)
    polylines.append(crv)
# ---------- end ghpython_script_5 ----------
trim_2 = TrimTree(Tree=sec, Depth=1)
item_6 = ListItem(List=trim_2, Index=0, Wrap=True)  # -> Item, Item1
explode_6 = Explode(Curve=ghpython_script_5.polylines, Recursive=True)  # -> Segments, Vertices
loft_3 = LoftPolylines(Curve0=item_6.Item, Curve1=item_6.Item1, Fast=invert(True))
cull_index_2 = CullIndex(List=explode_6.Vertices, Indices=0, Wrap=True)
mesh_4 = Mesh(simplify(flatten(loft_3)))
construct_mesh_2 = ConstructMesh(Vertices=cull_index_2, Faces={A=0, B=1, C=2, D=2})
edges = NGonEdges(Mesh=fromp)  # -> Edges, ID, NakedID, Normal, Naked, AllE
mesh_5 = Mesh(construct_mesh_2)
mesh_join = MeshJoin(Meshes=flatten([mesh_5, mesh_3, mesh_2]))
not = GateNot(A=edges.NakedID)
number_slider_7 = Slider(0.146, range=0..1)
mesh_weldvertices = MeshWeldVertices(Mesh=mesh_join, Tolerance=0.01)  # -> RuntimeMessage, Mesh
mesh_6 = Mesh(mesh_weldvertices.Mesh)
number_slider_8 = Slider(0.05, range=0..0.1)
number_slider_9 = Slider(0.05, range=0..0.1)
python_3 = GhPythonScript(rhino_mesh=mesh_6)  # -> out, points, mesh, vectors, planes, planes_per_vertex, lengths; inputs rhino_mesh: Mesh
# ---------- python_3: Python ----------
import math
from compas.datastructures import Mesh
from compas.geometry import Point, Vector, Plane
from compas_rhino.conversions import plane_to_rhino
from compas_rhino.conversions import RhinoMesh
import Rhino.Geometry as rg


def plane_on_midpoint_edge(edge):
    
    adjacent_faces = mesh.edge_faces(edge[0], edge[1])

    v = mesh.face_normal(adjacent_faces[0])
    v1 = rg.Vector3d(v[0], v[1], v[2])
    _v= mesh.face_normal(adjacent_faces[1])
    v2 = rg.Vector3d(_v[0], _v[1], _v[2])
    
    y = 0.5*(v1 + v2)
    
    c = mesh.edge_midpoint(edge[0], edge[1])
    c = rg.Point3d(c[0], c[1], c[2])
    
    x = mesh.edge_vector(edge[0], edge[1])
    x = rg.Vector3d(x[0], x[1], x[2])
    
    
    plane = rg.Plane(c, x, y )
    
    return plane

temp = RhinoMesh.from_geometry(rhino_mesh)
mesh = temp.to_compas()

print mesh

edges = list(mesh.edges())
vertices = list(mesh.vertices())

vectors = []
planes = []
lengths = []
points = []

for edge in edges:
    plane = plane_on_midpoint_edge(edge)
    planes.append(plane)
    length = mesh.edge_length(edge[0], edge[1])
    lengths.append(length)

planes_per_vertex = []
for i,vertex in enumerate(vertices):
    vecs = []
    ppv = []
    
    point = mesh.vertex_coordinates(i)
    point = Point(point[0], point[1], point[2])
    points.append(point)
        
    edges = mesh.vertex_edges(vertex)
    for edge in edges:
        plane = plane_on_midpoint_edge(edge)
        
        
        p1 = mesh.vertex_coordinates(edge[0])
        p2 = mesh.vertex_coordinates(edge[1])
        p1 = rg.Point3d(p1[0], p1[1], p1[2])
        p2 = rg.Point3d(p2[0], p2[1], p2[2])
        
        if edge[0]== i:
            vec = p2 - p1
        else:
            vec = p1 - p2
        
        vec.Unitize()
        vecs.append(vec)
        
        #correct plane so that x axis has the same direction as the vector
        angle = rg.Vector3d.VectorAngle(plane.XAxis,vec, plane.Normal)
        if angle>0:
            plane.XAxis, plane.YAxis = -plane.XAxis, -plane.YAxis
        ppv.append(plane)
            
    vectors.append(vecs)
    planes_per_vertex.append(ppv)
# ---------- end python_3 ----------
expression = Expression(x=python_3.lengths, y=number_slider_7, Expression="- 0.5 * x + y")
expression_2 = Expression(x=python_3.lengths, y=number_slider_7, Expression="0.5 * x - y")
dom_2 = ConstructDomain(DomainStart=expr("- 0.5 * x", number_slider_8), DomainEnd=expr("0.5 * x", number_slider_8))
dom_3 = ConstructDomain(DomainStart=expr("- 0.5 * x", number_slider_9), DomainEnd=expr("0.5 * x", number_slider_9))
dom_4 = ConstructDomain(DomainStart=expression, DomainEnd=expression_2)
ghpython_script_6 = GhPythonScript(x=python_3.planes_per_vertex)  # -> out, a
# ---------- ghpython_script_6: Python ----------
a=x
# ---------- end ghpython_script_6 ----------
python_4 = GhPythonScript(x=python_3.vectors)  # -> simplify(a)
# ---------- python_4: Python ----------
a = x
# ---------- end python_4 ----------
draw = Draw(cg=python_3.mesh)  # -> rg
#   port cg: The COMPAS geometry or datastructure to be drawn.
#   port rg: The Rhino geometry object.
# ---------- draw: Python ----------
"""
Draws COMPAS geometry in Grasshopper.
"""
from ghpythonlib.componentbase import executingcomponent as component

from compas.artists import Artist


class CompasToRhinoGeometry(component):
    def RunScript(self, cg):
        if not cg:
            return None

        return Artist(cg).draw()
# ---------- end draw ----------
draw_2 = Draw(cg=python_3.points)  # -> rg; same code as draw
planes_per_vertex = Plane(ghpython_script_6.a)
deconstruct_plane = DeconstructPlane(Plane=planes_per_vertex)  # -> Origin, XAxis, YAxis, ZAxis
box = DomainBox(Base=python_3.planes, X=dom_4, Y=dom_2, Z=dom_3)
construct_domain = ConstructDomain(DomainStart=expr("-0.5*x", number_slider_9), DomainEnd=expr("0.5*x", number_slider_9))
construct_plane = ConstructPlane(Origin=graft(draw_2), XAxis=deconstruct_plane.ZAxis, YAxis=deconstruct_plane.YAxis)
deconstruct_plane_2 = DeconstructPlane(Plane=construct_plane)  # -> Origin, XAxis, YAxis, ZAxis
rectangle_2 = Rectangle(Plane=construct_plane, XSize=construct_domain, YSize=construct_domain, Radius=0)  # -> Rectangle, Length
amplitude = Amplitude(Vector=expr("-x", deconstruct_plane_2.ZAxis), Amplitude=number_slider_7)
move_3 = Move(Geometry=rectangle_2.Rectangle, Motion=amplitude)  # -> Geometry, Transform
ghpython_script_7 = GhPythonScript(sections=simplify(move_3.Geometry), point=graft(draw_2))  # -> out, meshes; inputs sections: list of Polyline, point: Point3d
# ---------- ghpython_script_7: Python ----------
__author__ = "eleni"
__version__ = "2024.03.22"

import Rhino.Geometry as rg

meshes = []

for s in sections:
    m = rg.Mesh()
    m.Vertices.Add(point)
    for i,p in enumerate(s):
        if i<len(s):
            m.Vertices.Add(p)
            
    m.Faces.AddFace(0,1,2)
    m.Faces.AddFace(0,2,3)
    m.Faces.AddFace(0,3,4)
    m.Faces.AddFace(0,4,5)
    m.Faces.AddFace(4,3,2,1)
    
    meshes.append(m)
# ---------- end ghpython_script_7 ----------
sphere = Sphere(Base=draw_2, Radius=Slider(0.035, range=0..0.1))
mesh_7 = Mesh(box)
mesh_8 = Mesh(ghpython_script_7.meshes)
geometry = Geometry(flatten([sphere, mesh_8, mesh_7]))
mesh_9 = Mesh(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)
# Subtractive
# 00
number_slider_10 = Slider(0, range=0..10)
deconstruct_mesh_2 = DeconstructMesh(Mesh=mesh_9)  # -> Vertices, Faces, Colours, Normals
panel_3 = Panel("""13
14
15""")
list_item_2 = ListItem(List=deconstruct_mesh_2.Normals, Index=0, Wrap=True)
populate_geometry_2 = PopulateGeometry(Geometry=mesh_9, Count=Slider(1000, range=0..1000), Seed=1)  # -> flatten(Population)
list_length_2 = ListLength(List=populate_geometry_2)
repeat_data_3 = RepeatData(Data=ColourSwatch(SwatchColor=RGB(171, 72, 72)), Length=list_length_2)
repeat_data_4 = RepeatData(Data=list_item_2, Length=list_length_2)

# ---- group: export mesh to .ply and joint indexes to .txt
ghpython_script_8 = GhPythonScript(meshes=mesh_9, idx=number_slider_10, folder_name="01_Subtractive", joint_faces_idx=panel_3, export=Toggle(True))  # -> out, a; inputs meshes: list of Mesh, joint_faces_idx: list, export: Boolean
# ---------- ghpython_script_8: Python ----------
__author__ = "eleni"
__version__ = "2024.03.20"

import Rhino
import System
import scriptcontext
import sys
import os


HERE = ghenv.LocalScope.ghdoc.Path
FOLDER = os.path.abspath(os.path.join(HERE, '..', '..', folder_name + "/0" + idx))
filename1 = "0" + idx + '_mesh.ply'
filepath = os.path.join(FOLDER, filename1)


#bake meshes to Rhino
new_attributes = Rhino.DocObjects.ObjectAttributes()

for mesh in meshes:  
    Rhino.RhinoDoc.ActiveDoc.Objects.AddMesh(mesh, new_attributes)

#export to .ply
    
write_options = Rhino.FileIO.FileWriteOptions()
write_options.WriteSelectedObjectsOnly = False

ply_options = Rhino.FileIO.FilePlyWriteOptions(write_options)
ply_options.UseSimpleDialog = True

if export:
    rc = Rhino.FileIO.FilePly.Write(filepath, Rhino.RhinoDoc.ActiveDoc, ply_options)
    if rc == Rhino.PlugIns.WriteFileResult.Success:
        print "Success, file saved:", filepath
    else:
        print "Error saving file:", filepath
    
    
#delete meshes from Rhino
objects = Rhino.RhinoDoc.ActiveDoc.Objects.FindByLayer("Default")
for obj in objects:
    Rhino.RhinoDoc.ActiveDoc.Objects.Remove(obj)
    
    
#export face indexes to .txt
filename2 = "0" + idx + '_joint_face_indexes.txt'
filepath = os.path.join(FOLDER, filename2)

with open(filepath, "w+") as f:
    for face in joint_faces_idx:
        data = str(face)
        f.write(data + "\n")
# ---------- end ghpython_script_8 ----------

# ---- group: export PCD to .ply
ghpython_script_9 = GhPythonScript(
    points=populate_geometry_2,
    colors=repeat_data_3,
    normals=repeat_data_4,
    idx=number_slider_10,
    folder_name="01_Subtractive",
    export=Toggle(True))  # -> out; inputs points: list of Point3d, colors: list, normals: list, export: Boolean; same code as ghpython_script_3

# ----
panel_4 = Panel(ghpython_script_9)
panel_5 = Panel(ghpython_script_8.out)
