# Grasshopper definition error_viz_tester_components.ghx (Grasshopper 1.0.8)
# plug-ins: RhinoCodePluginGH, MeshEdit Components

construct_point = ConstructPoint(XCoordinate=Slider(1, range=0..1), YCoordinate=Slider(0, range=0..1), ZCoordinate=Slider(0, range=0..1))
unbooleaned = Brep([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])
reciprocal = Brep([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])
mesh = Mesh(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)
move = Move(Geometry=mesh, Motion=construct_point)  # -> Geometry, Transform
volume = Volume(Geometry=move.Geometry)  # -> Volume, Centroid
dfbuildassembly = DFBuildAssembly(i_assembly_name="test", i_breps=reciprocal)  # -> o_assembly; inputs i_assembly_name: String, i_breps: list of Brep
#   port i_assembly_name: The name of the assembly to export.
#   port i_breps: The breps of the structure.
#   port o_assembly: The create DFAssembly object representing the timber elements.
# ---------- dfbuildassembly: Python ----------
#! python3

import System
import typing

import Rhino
import Rhino.Geometry as rg
import scriptcontext as sc

from ghpythonlib.componentbase import executingcomponent as component

import diffCheck
from diffCheck.df_geometries import DFBeam, DFAssembly


class DFBuildAssembly(component):
    def RunScript(self,
            i_assembly_name,
            i_breps : System.Collections.Generic.IList[Rhino.Geometry.Brep]):
        """
            This component parse a series of breps representing a timber structure or a 
            timber elements into a DFAssembly object.
            
            :param i_assembly_name: the name of the assembly
            :param i_breps: list of breps

            :return o_assembly: the DFAssembly object
        """
        beams: typing.List[DFBeam] = []
        for brep in i_breps:
            beam = DFBeam.from_brep_face(brep)
            beams.append(beam)

        o_assembly = DFAssembly(beams, i_assembly_name)

        return o_assembly


# if __name__ == "__main__":
#     comp = DFBuildAssembly()
#     o_assembly = comp.RunScript(
#         i_assembly_name,
#         i_breps
#     )
# ---------- end dfbuildassembly ----------
scale = Scale(Geometry=move.Geometry, Center=volume.Centroid, Factor=Slider(1.1, range=0..10))  # -> Geometry, Transform
number_slider = Slider(200, range=0..600)
mesh_explode = MeshExplode(Mesh=mesh, Interpolate=False)
mesh_explode_2 = MeshExplode(Mesh=scale.Geometry, Interpolate=False)
dfdeconstructassembly = DFDeconstructAssembly(i_assembly=dfbuildassembly)  # -> o_beams
#   port i_assembly: The DFAssembly object to deconstruct.
#   port o_beams: The set of beams contained by this DFAssembly object.
# ---------- dfdeconstructassembly: Python ----------
#! python3

import System
import typing

import Rhino
import Rhino.Geometry as rg
import scriptcontext as sc

from ghpythonlib.componentbase import executingcomponent as component

import diffCheck
from diffCheck.df_geometries import DFBeam, DFAssembly


class DFDeconstructAssembly(component):
    def RunScript(self,
            i_assembly):
        """
            Deconstruct the DFAssembly into a set of df_beams objects.
            
            :param i_assembly: the DFAssembly object

            :return o_beams
        """
        o_beams = i_assembly.beams

        return o_beams


# if __name__ == "__main__":
#     comp = DFDeconstructAssembly()
#     o_beams = comp.RunScript(
#         i_assembly
#     )
# ---------- end dfdeconstructassembly ----------
dfdeconstructbeam = DFDeconstructBeam(i_beams=graft(dfdeconstructassembly))  # -> o_side_faces, o_joint_faces, o_joint_ids; inputs i_beams: list
#   port i_beams: The DFBeam objects to deconstruct.
#   port o_side_faces: The side faces of as Breps of the beam.
#   port o_joint_faces: The faces as Breps belonging to joints of the beam.
#   port o_joint_ids: An integer indicating to which joint the joint faces are belonging to.
# ---------- dfdeconstructbeam: Python ----------
#! python3

import System
import typing

import Rhino
import Rhino.Geometry as rg
import scriptcontext as sc

from ghpythonlib.componentbase import executingcomponent as component

import diffCheck
from diffCheck.df_geometries import DFBeam, DFAssembly


class DFDeconstructBeam(component):
    def RunScript(self,
            i_beams : typing.List[DFBeam]):
        """
            Deconstruct the DFBeam object into Rhino objects.
            
            :param i_beams: the DFBeam objects

            :return o_side_faces: the side joints of the beam
            :return o_joint_faces: the face joints of the beam
            :return o_joint_ids: the ids for each face joint
        """
        o_side_faces, o_joint_faces, o_joint_ids, o_breps = [], [], [], []

        for i_b in i_beams:
            o_side_faces = [f.to_brep_face() for f in i_b.side_faces]
            o_joint_faces = [f.to_brep_face() for f in i_b.joint_faces]
            o_joint_ids = [f.joint_id for f in i_b.joint_faces]

        return o_side_faces, o_joint_faces, o_joint_ids

# if __name__ == "__main__":
#     comp = DFDeconstructBeam()
#     o_side_faces, o_joint_faces, o_joint_ids = comp.RunScript(
#         i_beams
#     )
# ---------- end dfdeconstructbeam ----------
tree_statistics = TreeStatistics(Tree=dfdeconstructbeam.o_side_faces)  # -> Paths, Length, Count
panel = Panel("""0
1""")
populate_geometry = PopulateGeometry(Geometry=mesh_explode_2, Count=number_slider, Seed=Slider(2, range=0..10))  # -> simplify(Population)
populate_geometry_2 = PopulateGeometry(Geometry=mesh_explode, Count=number_slider, Seed=1)
list_item = ListItem(List=tree_statistics.Paths, Index=panel, Wrap=True)
list_item_2 = ListItem(List=dfdeconstructassembly, Index=panel, Wrap=True)
tree_branch = TreeBranch(Tree=dfdeconstructbeam.o_side_faces, Path=list_item, MaintainPaths=True)
tree_branch_2 = TreeBranch(Tree=dfdeconstructbeam.o_joint_faces, Path=list_item, MaintainPaths=True)
flatten_tree = FlattenTree(Tree=populate_geometry, Path="{0}")
colour_swatch = ColourSwatch(SwatchColor=RGB(255, 255, 255))
flatten_tree_2 = FlattenTree(Tree=populate_geometry_2, Path="{0}")
point_cloud_attributes = PointCloudAttributes(Locations=flatten_tree)  # -> Cloud, Locations, Normals, Colours, Extra, Hidden
populate_geometry_3 = PopulateGeometry(Geometry=[tree_branch, tree_branch_2], Count=number_slider, Seed=1)
point_cloud_attributes_2 = PointCloudAttributes(Locations=flatten_tree_2)  # -> Cloud, Locations, Normals, Colours, Extra, Hidden
move_2 = Move(Geometry=point_cloud_attributes_2.Cloud, Motion=Vector(0, 0, 10))  # -> Geometry, Transform
trim_tree = TrimTree(Tree=populate_geometry_3, Depth=1)
boolean_toggle = BooleanToggle(True)
point_cloud_attributes_3 = PointCloudAttributes(Locations=trim_tree)  # -> Cloud, Locations, Normals, Colours, Extra, Hidden
button = Button()
number_slider_2 = Slider(10, range=0..10)
point_cloud = PointCloud([point_cloud_attributes.Cloud, move_2.Geometry])
point_cloud_2 = PointCloud([point_cloud_attributes_2.Cloud, move_2.Geometry])
xy_plane = XYPlane(Origin=Point(0, 0, 0))

palette = ValueList({"Jet", "Rainbow", "RdPu", "Viridis"}, selected="RdPu")
panel_2 = Panel(palette)
valuetype = ValueList({"Dist", "MSE", "MAX", "MIN", "STD"}, selected="Dist")
viz_settings = ScriptSyncCpython(
    select_file=Button(),
    packages_2_reload="diffCheck",
    i_value_type=valuetype,
    i_legend_height=number_slider_2,
    i_legend_width=Slider(0.6, range=0..1),
    i_legend_plane=xy_plane,
    i_histogram_scale_factor=Slider(0.002, range=0..0.01))  # -> stdout, o_viz_settings; inputs select_file: Boolean, packages_2_reload: list of String, i_upper_threshold: Boolean
#   port select_file: Connect a button to open a file dialog to select a cpython file to run.
#   port packages_2_reload: Pass a list with the name of the custom packages you want to reload. This function is useful if you are developing a i.e. PyPI package and you want to reload the submodules after you modified something. The function will reload the package and all its submodules. If you want to reload the package and all its submodules, just pass the package name. If you want to reload only a submodule, pass the package name and the submodule name separated by a dot. If you want to reload multiple submodules, pass the package
#   port stdout: The redirected standard output of the component scriptsync.
# ---------- viz_settings: Python ----------
from ghpythonlib.componentbase import executingcomponent as component

import System
import System.Drawing
import Rhino
import rhinoscriptsyntax as rs
import Grasshopper
import Grasshopper as gh
from Grasshopper.Kernel import GH_RuntimeMessageLevel as RML
import sys
import os
import time

import contextlib
import io

import abc
import socket
import threading
import queue
import json

import importlib
import sys

import traceback


class GHThread(threading.Thread, metaclass=abc.ABCMeta):
    """
        A base class for Grasshopper threads.
    """
    def __init__(self, name : str):
        super().__init__(name=name, daemon=False)
        self._component_on_canvas = True
        self._component_enabled = True

    @abc.abstractmethod
    def run(self):
        """ Run the thread. """
        pass

    def _check_if_component_on_canvas(self):
        """ Check if the component is on canvas from thread. """
        def __check_if_component_on_canvas():
            if ghenv.Component.OnPingDocument() is None:
                self._component_on_canvas = False
                return False
            else:
                self._component_on_canvas = True
                return True
        action = System.Action(__check_if_component_on_canvas)
        Rhino.RhinoApp.InvokeOnUiThread(action)

    def _check_if_component_enabled(self):
        """ Check if the component is enabled from thread. """
        def __check_if_component_enabled():
            if ghenv.Component.Locked:
                self._component_enabled = False
            else:
                self._component_enabled = True
        action = System.Action(__check_if_component_enabled)
        Rhino.RhinoApp.InvokeOnUiThread(action)

    def expire_component_solution(self):
        """ Fire the recalculation of the component solution from thread. """
        def __expire_component_solution():
            ghenv.Component.Params.Output[0].ClearData()  # clear the output
            ghenv.Component.ExpireSolution(True)  # expire the component
        action = System.Action(__expire_component_solution)
        Rhino.RhinoApp.InvokeOnUiThread(action)

    def clear_component(self):
        """ Clear the component from thread. """
        def __clear_component():
            ghenv.Component.ClearData()
        action = System.Action(__clear_component)
        Rhino.RhinoApp.InvokeOnUiThread(action)

    def add_runtime_warning(self, exception : str):
        """ Add a warning tab to the component from main thread. """
        action = System.Action(
            lambda: ghenv.Component.AddRuntimeMessage(RML.Warning, exception)
        )
        Rhino.RhinoApp.InvokeOnUiThread(action)

    def add_runtime_error(self, exception : str):
        """ Add an error tab to the component from main thread. """
        action = System.Action(
            lambda: ghenv.Component.AddRuntimeMessage(RML.Error, exception)
        )
        Rhino.RhinoApp.InvokeOnUiThread(action)

    def add_runtime_remark(self, exception : str):
        """ Add a blank tab to the component from main thread. """
        action = System.Action(
            lambda: ghenv.Component.AddRuntimeMessage(RML.Remark, exception)
        )
        Rhino.RhinoApp.InvokeOnUiThread(action)

    @property
    def component_enabled(self):
        self._check_if_component_enabled()
        return self._component_enabled

    @property
    def component_on_canvas(self):
        self._check_if_component_on_canvas()
        return self._component_on_canvas

class ClientThread(GHThread):
    """
    A thread to connect to the VSCode server.
    """
    def __init__(self, vscode_server_ip: str, vscode_server_port: int, name: str,
                 queue_msg: queue.Queue = None, lock_queue_msg: threading.Lock = None,
                 event_fire_msg: threading.Event = None):
        super().__init__(name=name)
        self.vscode_server_ip = vscode_server_ip
        self.vscode_server_port = vscode_server_port
        self.is_connected = False
        self.connect_refresh_rate = 1  # seconds
        self.queue_msg = queue_msg
        self.lock_queue_msg = lock_queue_msg
        self.event_fire_msg = event_fire_msg
        self.client_socket = socket.socket(socket.AF_INET, socket.SOCK_STREAM)

    def run(self):
        """ Run the thread. Send the message to the vscode server."""
        while self.component_on_canvas and self.component_enabled:
            try:
                if not self.is_connected:
                    self.connect_to_vscode_server()
                    self.clear_component()
                    self.expire_component_solution()
                    continue

                self.event_fire_msg.wait()
                self.send_message_from_queue()

            except Exception as e:
                self.add_runtime_warning(f"script-sync::Unkown error from run: {str(e)}")
                self.is_connected = False
                self.client_socket = socket.socket(socket.AF_INET, socket.SOCK_STREAM)

        self.client_socket.close()

    def send_message_from_queue(self):
        with self.lock_queue_msg:
            if self.queue_msg and not self.queue_msg.empty():
                msg = self.queue_msg.get()
                self.queue_msg.task_done()
                self.event_fire_msg.set()
                self.event_fire_msg.clear()
                self.client_socket.send(msg)

    def connect_to_vscode_server(self):
        """ Connect to the VSCode server. """
        while self.component_on_canvas and not self.is_connected:
            try:
                self.client_socket.send(b"")
                self.is_connected = True
            except socket.error:
                try:
                    self.client_socket.connect((self.vscode_server_ip, self.vscode_server_port))
                    self.is_connected = True
                except (ConnectionRefusedError, ConnectionResetError, socket.error) as e:
                    self.handle_connection_error(e)
            finally:
                time.sleep(self.connect_refresh_rate)

    def handle_connection_error(self, e):
        error_messages = {
            ConnectionRefusedError: "script-sync::Connection refused by the vscode",
            ConnectionResetError: "script-sync::Connection was forcibly closed by the vscode",
            socket.error: f"script-sync::Error connecting to the vscode: {str(e)}, have you tried to press Shift+F4 on VSCode?"
        }
        self.add_runtime_warning(error_messages[type(e)])
        self.is_connected = False if type(e) != socket.error or e.winerror != 10056 else True

class FileChangedThread(GHThread):
    """
        A thread to check if the file has changed on disk.
    """
    def __init__(self,
                path : str,
                name : str
                ):
        super().__init__(name=name)
        self.path = path
        self.refresh_rate = 1000  # milliseconds
        self._on_file_changed = threading.Event()

    def run(self):
        """
            Check if the file has changed on disk.
        """
        last_modified = os.path.getmtime(self.path)
        while self.component_on_canvas and not self._on_file_changed.is_set():
            System.Threading.Thread.Sleep(self.refresh_rate)
            last_modified = self.is_file_modified(last_modified)
        self._on_file_changed.clear()
        return

    def stop(self):
        """ Stop the thread. """
        self._on_file_changed.set()

    def is_file_modified(self, last_modified):
        current_modified = os.path.getmtime(self.path)
        if current_modified != last_modified:
            self.expire_component_solution()
            return current_modified
        return last_modified

class ScriptSyncCPy(component):
    def __init__(self):
        super(ScriptSyncCPy, self).__init__()
        self._var_output = []

        self.is_success = False

        self.client_thread_name : str = f"script-sync-client-thread::{ghenv.Component.InstanceGuid}"
        self.vscode_server_ip = "127.0.0.1"
        self.vscode_server_port = 58260
        self.stdout = None
        self.queue_msg = queue.Queue()
        self.queue_msg_lock = threading.Lock()
        self.event_fire_msg = threading.Event()

        self.filechanged_thread_name : str = f"script-sync-fileChanged-thread::{ghenv.Component.InstanceGuid}"
        self.__path_name_table_value = "script-sync::" + "path::" + str(ghenv.Component.InstanceGuid)
        if self.path is None:
            ghenv.Component.Message = "select-script"

    def RemovedFromDocument(self, doc):
        """ Remove the component from the document. """
        if self.client_thread_name in [t.name for t in threading.enumerate()]:
            client_thread = [t for t in threading.enumerate() if t.name == self.client_thread_name][0]
            client_thread.join()
        if self.filechanged_thread_name in [t.name for t in threading.enumerate()]:
            filechanged_thread = [t for t in threading.enumerate() if t.name == self.filechanged_thread_name][0]
            filechanged_thread.join()
        if self.queue_msg is not None:
            self.queue_msg.join()
        if self.queue_msg_lock is not None:
            self.queue_msg_lock.release()
        if self.event_fire_msg is not None:
            self.event_fire_msg.clear()

        # clear the path from the table view
        del self.path

    def init_script_path(self, select_file : bool = False):
        """
            Check if the button is pressed and load/change path script.
            
            :param select_file: A boolean of the button
        """
        # check if button is pressed
        if select_file is True:
            filename = rs.OpenFileName("Open", "Python Files (*.py)|*.py||")
            if filename is None:
                raise Exception("script-sync::No file selected")
            self.path = filename

        # fi file is in table view before
        if not os.path.exists(self.path):
            raise Exception("script-sync::File does not exist")
    
    def reload_all_modules(self, directory):
        for filename in os.listdir(directory):
            if filename.endswith('.py') and filename != '__init__.py':
                module_name = filename[:-3]  # remove '.py' from filename
                if module_name in sys.modules:
                    importlib.reload(sys.modules[module_name])

    def safe_exec(self, path, globals, locals, packages_2_reload):
        """
            Execute Python3 code safely. It redirects the output of the code
            to a string buffer 'stdout' to output to the GH component param.
            It is send to the vscode server.
            
            :param path: The path of the file to execute.
            :param globals: The globals dictionary.
            :param locals: The locals dictionary.
            :param packages_2_reload: The list of packages to reload, this is used for custom packages developement.
            installed on the system via an editable pip installation for example.
        """
        try:
            with open(path, 'r') as f:
                # reload the specifyed packages
                if packages_2_reload is not None:
                    if packages_2_reload.__len__() != 0:
                        for package in packages_2_reload:
                            for key in list(sys.modules.keys()):
                                if package in key:
                                    #check that the package must have the attribute __file__ (to avoid reloading pyd)
                                    if hasattr(sys.modules[key], '__file__'):
                                        importlib.reload(sys.modules[key])

                # add the path and sub directories to  the sys path
                path_dir = os.path.dirname(path)
                sub_dirs = []
                for root, dirs, files in os.walk(path_dir):
                    for d in dirs:
                        sub_dirs.append(os.path.join(root, d))
                sys.path.extend([path_dir] + sub_dirs)

                # reload all the modules also of the sub directories
                for root, dirs, files in os.walk(path_dir):
                    for d in dirs:
                        self.reload_all_modules(os.path.join(root, d))
                self.reload_all_modules(path_dir)

                # refresh the python interpreter
                importlib.invalidate_caches()

                # parse the code
                code = compile(f.read(), path, 'exec')
                output = io.StringIO()

                # empty the queue and event
                with self.queue_msg_lock:
                    while not self.queue_msg.empty():
                        self.queue_msg.get()
                        self.queue_msg.task_done()
                self.event_fire_msg.clear()

                # clear all the locals dictionary to avoid that the output variables stick between the component
                # executions when it is recomputed
                outparam = ghenv.Component.Params.Output
                outparam_names = [p.NickName for p in outparam]
                for outp in outparam_names:
                    if outp in locals.keys():
                        del locals[outp]

                # execute the code
                with contextlib.redirect_stdout(output):
                    exec(code, globals, locals)
                locals["stdout"] = output.getvalue()

                # send the msg to the vscode server
                msg_json = json.dumps({"script_path": path,
                                       "guid": str(ghenv.Component.InstanceGuid),
                                       "msg": output.getvalue()})
                msg_json = msg_json.encode('utf-8')
                self.queue_msg.put(msg_json)
                self.event_fire_msg.set()

                # pass the script variables to the GH component outputs
                for outp in outparam_names:
                    if outp in locals.keys():
                        self._var_output.append(locals[outp])
                    else:
                        self._var_output.append(None)

                sys.stdout = sys.__stdout__
            return locals

        except Exception as e:
            # Get the traceback
            tb = traceback.format_exc()

            # Send the error message to the vscode server
            err_json = json.dumps({
                "script_path": path,
                "guid": str(ghenv.Component.InstanceGuid),
                "msg": "err:" + str(e),
                "traceback": tb  # Include the traceback in the JSON
            })
            err_json = err_json.encode('utf-8')
            self.queue_msg.put(err_json)
            self.event_fire_msg.set()

            sys.stdout = sys.__stdout__

            err_msg = f"script-sync::Error in the code: {str(e)}\n{tb}"
            raise Exception(err_msg)

    def RunScript(self,
        select_file: bool,
        packages_2_reload : list,
        i_value_type,
        i_upper_threshold: bool,
        i_lower_threshold,
        i_palette,
        i_legend_height,
        i_legend_width,
        i_legend_plane,
        i_histogram_scale_factor
    ):
        """ This method is called whenever the component has to be recalculated it's the solve main instance. """
        self.is_success = False

        # set the path if button is pressed
        self.init_script_path(select_file)

        # file change listener thread
        if self.filechanged_thread_name not in [t.name for t in threading.enumerate()]:
            FileChangedThread(self.path,
                              self.filechanged_thread_name
                              ).start()

        # set up the tcp client to connect to the vscode server
        _ = [print(t.name) for t in threading.enumerate()]
        if self.client_thread_name not in [t.name for t in threading.enumerate()]:
            ClientThread(self.vscode_server_ip,
                        self.vscode_server_port,
                        self.client_thread_name,
                        self.queue_msg,
                        self.queue_msg_lock,
                        self.event_fire_msg
                        ).start()

        # add to the globals all the input parameters of the component (the locals)
        globals().update(locals())

        res = self.safe_exec(self.path, None, globals(), packages_2_reload)
        self.is_success = True
        return

    def is_nested_iterable(self, lst):
        """ Detect if a list is nested. """
        return any(isinstance(i, list) for i in lst)

    def AfterRunScript(self):
        """
            This method is called as soon as the component has finished
            its calculation. It is used to load the GHComponent outputs
            with the values created in the script.
        """
        if not self.is_success:
            return

        outparam = [p for p in ghenv.Component.Params.Output]
        outparam_names = [p.NickName for p in outparam]

        for idx, outp in enumerate(outparam):
            # detect if the output is a list
            if type(self._var_output[idx]) == tuple:
                ghenv.Component.Params.Output[idx].VolatileData.Clear()
                ghenv.Component.Params.Output[idx].AddVolatileDataList(gh.Kernel.Data.GH_Path(0), self._var_output[idx])
            # TODO: increase the number of nested lists they can be handles (max 2 deep for now)
            elif type(self._var_output[idx]) == list:
                ghenv.Component.Params.Output[idx].VolatileData.Clear()
                if self.is_nested_iterable(self._var_output[idx]):
                    nbr_lists_aka_branches = len(self._var_output[idx])
                    for i in range(nbr_lists_aka_branches):
                        ghenv.Component.Params.Output[idx].AddVolatileDataList(gh.Kernel.Data.GH_Path(i), self._var_output[idx][i])
                else:
                    ghenv.Component.Params.Output[idx].AddVolatileDataList(gh.Kernel.Data.GH_Path(0), self._var_output[idx])
            else:
                ghenv.Component.Params.Output[idx].VolatileData.Clear()
                ghenv.Component.Params.Output[idx].AddVolatileData(gh.Kernel.Data.GH_Path(0), 0, self._var_output[idx])
        self._var_output.clear()

    @property
    def path(self):
        """ Get the path of the file from the table view to be sticking between the sessions. """
        table_value = ghenv.Component.OnPingDocument().ValueTable.GetValue(
            self.__path_name_table_value, "not_found"
        )
        if table_value != "not_found":
            return table_value
        else:
            return None

    @path.setter
    def path(self, path : str):
        """ Set the path of the file to the table view to be sticking between the sessions. """
        ghenv.Component.OnPingDocument().ValueTable.SetValue(self.__path_name_table_value, path)

        script_name = os.path.basename(path)
        ghenv.Component.Message = f"{script_name}"

        if self.filechanged_thread_name in [t.name for t in threading.enumerate()]:
            _ = [t for t in threading.enumerate() if t.name == self.filechanged_thread_name][0].stop()

    @path.deleter
    def path(self):
        """ Delete the path of the file from the table view if the object is erased. """
        ghenv.Component.OnPingDocument().ValueTable.DeleteValue(self.__path_name_table_value)
# ---------- end viz_settings ----------

unit_z = UnitZ(Factor=Slider(0.1, range=0..18))
dfcloudclouddistance = DFCloudCloudDistance(i_cloud_source=point_cloud_2, i_cloud_target=point_cloud)  # -> o_distances, o_mse, o_max_deviation, o_min_deviation, o_std_deviation, o_results; inputs i_cloud_source: list, i_cloud_target: list, i_swap: Boolean
#   port i_cloud_source: The source point cloud.
#   port i_cloud_target: The target cloud.
#   port i_swap: whether to swap source and target
#   port o_results: The result of the distance calculation.
# ---------- dfcloudclouddistance: Python ----------
#! python3

import System
import typing

import Rhino
import Rhino.Geometry as rg
from ghpythonlib.componentbase import executingcomponent as component

import Grasshopper as gh
from Grasshopper.Kernel import GH_RuntimeMessageLevel as RML

import diffCheck
from diffCheck import df_cvt_bindings
from diffCheck import df_error_estimation

import diffCheck.df_util


class CloudCloudDistance(component):
    def RunScript(self,
        i_cloud_source:  typing.List[rg.PointCloud],
        i_cloud_target: typing.List[rg.PointCloud],
        i_swap: bool):
        """
            The cloud-to-cloud component computes the distance between each point in the source point cloud and its nearest neighbour in thr target point cloud.

            :param i_cloud_source: a list of source point cloud
            :param i_cloud_target: a list of target point cloud to calculate distances to

            :return o_distances : list of calculated distances for each point
            :return o_mse: the average squared difference between corresponding points of source and target
            :return o_max_deviation: the max deviation between source and target
            :return o_min_deviation: the min deviation between source and target
            :return o_std_deviation: the standard deviation between source and target
            :returns o_resluts: the results of the comparison all in one object
        """

        if i_cloud_source is None or i_cloud_target is None:
            ghenv.Component.AddRuntimeMessage(RML.Warning, "Please provide both objects of type point clouds to compare")
            return None

        # swap
        if i_swap is True:
            temp = i_cloud_source
            i_cloud_source = i_cloud_target
            i_cloud_target = temp

        # conversion
        df_cloud_source_list = [df_cvt_bindings.cvt_rhcloud_2_dfcloud(i_cl_s) for i_cl_s in i_cloud_source]
        df_cloud_target_list = [df_cvt_bindings.cvt_rhcloud_2_dfcloud(i_cl_t) for i_cl_t in i_cloud_target]

        # calculate distances
        o_results = df_error_estimation.cloud_2_cloud_comparison(df_cloud_source_list, df_cloud_target_list)

        return o_results.distances, o_results.distances_mse, o_results.distances_max_deviation, o_results.distances_min_deviation, o_results.distances_sd_deviation, o_results


# if __name__ == "__main__":
#     com = CloudCloudDistance()
#     o_distances, o_mse, o_max_deviation, o_min_deviation, o_std_deviation, o_results = com.RunScript(
#         i_cloud_source,
#         i_cloud_target,
#         i_swap
#         )
# ---------- end dfcloudclouddistance ----------
dfvizualizationsettings = DFVizualizationSettings(i_value_type=valuetype, i_palette=palette, i_legend_height=number_slider_2)  # -> o_viz_settings; inputs i_value_type: String, i_upper_threshold: Double, i_lower_threshold: Double, i_palette: String, i_legend_height: Double, i_legend_width: Double, i_legend_plane: Plane, i_histogram_scale_factor: Double
#   port i_value_type: Which values to display.
#   port i_upper_threshold: Thresholds the values with a maximum value
#   port i_lower_threshold: Thresholds the values with a minimum value
#   port i_palette: Select a color palette to map the values to
#   port i_legend_height: Set the total height of the legend
#   port i_legend_width: Set the total width of the legend
#   port i_legend_plane: A construction plane for the legend
#   port i_histogram_scale_factor: Scales the height of the histogram with a factor
#   port o_viz_settings: Settings to be passed to the Vizualization component
# ---------- dfvizualizationsettings: Python ----------
#! python3

import System
import typing

import Rhino
import Rhino.Geometry as rg
from ghpythonlib.componentbase import executingcomponent as component

import Grasshopper as gh
from Grasshopper.Kernel import GH_RuntimeMessageLevel as RML

from diffCheck import df_vizualization

class VisualizationSettings(component):
    def RunScript(self,
        i_value_type,
        i_upper_threshold,
        i_lower_threshold,
        i_palette,
        i_legend_height,
        i_legend_width,
        i_legend_plane,
        i_histogram_scale_factor):

        """
        Compiles all the vizualization settings to feed to the vizualization component
        """

        # set default values
        if i_palette is None: i_palette = "Jet"
        if i_legend_height is None: i_legend_height = 10
        if i_legend_width is None: i_legend_width = 0.5
        if i_legend_plane is None: i_legend_plane = rg.Plane.WorldXY
        if i_histogram_scale_factor is None: i_histogram_scale_factor = 0.01

        # pack settings
        o_viz_settings = df_vizualization.DFVizSettings(i_value_type,
                                                        i_upper_threshold,
                                                        i_lower_threshold,
                                                        i_palette,
                                                        i_legend_height,
                                                        i_legend_width,
                                                        i_legend_plane,
                                                        i_histogram_scale_factor)

        return o_viz_settings

# if __name__ == "__main__":
#     com = VisualizationSettings()
#     o_viz_settings = com.RunScript(
#         i_value_type,
#         i_upper_threshold,
#         i_lower_threshold,
#         i_palette,
#         i_legend_height,
#         i_legend_width,
#         i_legend_plane,
#         i_histogram_scale_factor
#         )
# ---------- end dfvizualizationsettings ----------
move_3 = Move(Geometry=flatten(point_cloud_attributes_3.Cloud), Motion=unit_z)  # -> Geometry, Transform
panel_3 = Panel("diffCheck")
button_2 = Button()
button_3 = Button()
beam = Data(list_item_2)
panel_4 = Panel(beam)
unit_x = UnitX(Factor=Slider(9, range=0..10))
dfcloudmeshdistance = DFCloudMeshDistance(
    i_cloud_source=move_3.Geometry,
    i_beam=beam,
    i_signed_flag=Toggle(False),
    i_swap=Toggle(True),
    i_analysis_resolution=Slider(0.1, range=0..1))  # -> o_distances, o_mse, o_max_deviation, o_min_deviation, o_std_deviation, o_results; inputs i_cloud_source: list, i_beam: list, i_signed_flag: Boolean, i_swap: Boolean, i_analysis_resolution: Double
#   port i_cloud_source: The source point cloud.
#   port i_beam: The target DFbeam
#   port i_signed_flag: whether to consider the sign of the distances
#   port i_swap: whether to swap source and target
#   port i_analysis_resolution: the maximum edge length of the mesh that is used for the distance calculation
#   port o_std_deviation: standard deviation between source and target.
#   port o_results: The result of the distance calculation.
# ---------- dfcloudmeshdistance: Python ----------
#! python3

import System
import typing

import Rhino
import Rhino.Geometry as rg
from ghpythonlib.componentbase import executingcomponent as component

import Grasshopper as gh
from Grasshopper.Kernel import GH_RuntimeMessageLevel as RML

import diffCheck
from diffCheck import df_cvt_bindings
from diffCheck import df_error_estimation
from diffCheck.df_geometries import DFBeam


class CloudMeshDistance(component):
    def RunScript(self,
        i_cloud_source: typing.List[rg.PointCloud],
        i_beam: typing.List[DFBeam],
        i_signed_flag: bool,
        i_swap: bool,
        i_analysis_resolution):

        """
            The cloud-to-cloud component computes the distance between each point in the source point cloud and its nearest neighbour in thr target point cloud.

            :param i_cloud_source: a list of point clouds
            :param i_beam: a list of DF beams
            :param i_signed_flag: calculate the sign of the distances
            :param i_swap: swap source and target

            :return o_distances : list of calculated distances for each point
            :return o_mse: the average squared difference between corresponding points of source and target
            :return o_max_deviation: the max deviation between source and target
            :return o_min_deviation: the min deviation between source and target
            :returns o_resluts: the results of the comparison all in one object
        """
        if i_analysis_resolution is None:
            scalef = diffCheck.df_util.get_doc_2_meters_unitf()
            i_analysis_resolution = 0.1 / scalef

        # conversion
        df_cloud_source_list = [df_cvt_bindings.cvt_rhcloud_2_dfcloud(i_cl_s) for i_cl_s in i_cloud_source]
        df_mesh_target_list = [beam.to_mesh(i_analysis_resolution) for beam in i_beam]

        # calculate distances
        o_results = df_error_estimation.cloud_2_rhino_mesh_comparison(df_cloud_source_list, df_mesh_target_list, i_signed_flag, i_swap)

        return o_results.distances, o_results.distances_mse, o_results.distances_max_deviation, o_results.distances_min_deviation, o_results.distances_sd_deviation, o_results


# if __name__ == "__main__":
#     com = CloudMeshDistance()
#     o_distances, o_mse, o_max_deviation, o_min_deviation, o_std_deviation, o_results = com.RunScript(
#         i_cloud_source,
#         i_beam,
#         i_signed_flag,
#         i_swap,
#         i_analysis_resolution
#         )
# ---------- end dfcloudmeshdistance ----------
move_4 = Move(Geometry=move_3.Geometry, Motion=unit_x)  # -> Geometry, Transform
file_path = FilePath("C:\Users\eleni\Desktop\DC\temp")
dfvizualization = DFVizualization(i_results=dfcloudclouddistance.o_results, i_viz_settings=dfvizualizationsettings)  # -> o_colored_geo, o_legend, o_histogram
#   port i_results: The result of the distance calculation
#   port i_viz_settings: The settings of the vizualization
#   port o_colored_geo: The geometry colored according to the distance results.
#   port o_legend: The legend of the vizualization
#   port o_histogram: Histogram that shows the frequency of the values
# ---------- dfvizualization: Python ----------
#! python3

import System
import typing

import Rhino
import Rhino.Geometry as rg
from ghpythonlib.componentbase import executingcomponent as component

import Grasshopper as gh
from Grasshopper.Kernel import GH_RuntimeMessageLevel as RML

from diffCheck import diffcheck_bindings
from diffCheck import df_cvt_bindings
from diffCheck import df_vizualization


class Vizualization(component):
    def RunScript(self,
                  i_results,
                  i_viz_settings):
        """
        Adds color to the mesh or point cloud
        and generates a corresponding legend and histogram
        """

        values, min_value, max_value = df_vizualization.filter_values_based_on_valuetype(i_results, i_viz_settings)

        # check if i_results.source is a list of pointclouds or a mesh
        if type(i_results.source[0]) is diffcheck_bindings.dfb_geometry.DFPointCloud:

            # convert to Rhino PCD
            o_source = [df_cvt_bindings.cvt_dfcloud_2_rhcloud(src) for src in i_results.source]

            # color geometry
            o_colored_geo = [df_vizualization.color_pcd(src, dist, min_value, max_value, i_viz_settings.palette) for src, dist in zip(o_source, values)]

        elif type(i_results.source[0]) is rg.Mesh:
            # convert to Rhino Mesh
            o_source = i_results.source

            # color geometry
            o_colored_geo = [df_vizualization.color_mesh(src, dist, min_value, max_value, i_viz_settings.palette) for src, dist in zip(o_source, values)]

        o_legend = df_vizualization.create_legend(min_value,
                                                  max_value,
                                                  i_viz_settings.palette,
                                                  steps=10,
                                                  plane=i_viz_settings.legend_plane,
                                                  width=i_viz_settings.legend_width,
                                                  total_height=i_viz_settings.legend_height)

        o_histogram = df_vizualization.create_histogram(values,
                                                        min_value,
                                                        max_value,
                                                        steps=100,
                                                        plane=i_viz_settings.legend_plane,
                                                        total_height=i_viz_settings.legend_height,
                                                        scaling_factor=i_viz_settings.histogram_scale_factor)
        return o_source, o_colored_geo, o_legend, o_histogram


# if __name__ == "__main__":
#     com = Vizualization()
#     o_source, o_colored_geo, o_legend, o_histogram  = com.RunScript(
#         i_results,
#         i_viz_settings
#         )
# ---------- end dfvizualization ----------
vizualization = ScriptSyncCpython(select_file=Button(), packages_2_reload="diffCheck", i_viz_settings=viz_settings.o_viz_settings)  # -> stdout, o_colored_geo, o_legend, o_histogram; inputs select_file: Boolean, packages_2_reload: list of String
#   port select_file: Connect a button to open a file dialog to select a cpython file to run.
#   port packages_2_reload: Pass a list with the name of the custom packages you want to reload. This function is useful if you are developing a i.e. PyPI package and you want to reload the submodules after you modified something. The function will reload the package and all its submodules. If you want to reload the package and all its submodules, just pass the package name. If you want to reload only a submodule, pass the package name and the submodule name separated by a dot. If you want to reload multiple submodules, pass the package
#   port i_results: A generic x input.
#   port stdout: The redirected standard output of the component scriptsync.
#   port o_colored_geo: Generic example output of the component
# ---------- vizualization: Python ----------
from ghpythonlib.componentbase import executingcomponent as component

import System
import System.Drawing
import Rhino
import rhinoscriptsyntax as rs
import Grasshopper
import Grasshopper as gh
from Grasshopper.Kernel import GH_RuntimeMessageLevel as RML
import sys
import os
import time

import contextlib
import io

import abc
import socket
import threading
import queue
import json

import importlib
import sys

import traceback


class GHThread(threading.Thread, metaclass=abc.ABCMeta):
    """
        A base class for Grasshopper threads.
    """
    def __init__(self, name : str):
        super().__init__(name=name, daemon=False)
        self._component_on_canvas = True
        self._component_enabled = True

    @abc.abstractmethod
    def run(self):
        """ Run the thread. """
        pass

    def _check_if_component_on_canvas(self):
        """ Check if the component is on canvas from thread. """
        def __check_if_component_on_canvas():
            if ghenv.Component.OnPingDocument() is None:
                self._component_on_canvas = False
                return False
            else:
                self._component_on_canvas = True
                return True
        action = System.Action(__check_if_component_on_canvas)
        Rhino.RhinoApp.InvokeOnUiThread(action)

    def _check_if_component_enabled(self):
        """ Check if the component is enabled from thread. """
        def __check_if_component_enabled():
            if ghenv.Component.Locked:
                self._component_enabled = False
            else:
                self._component_enabled = True
        action = System.Action(__check_if_component_enabled)
        Rhino.RhinoApp.InvokeOnUiThread(action)

    def expire_component_solution(self):
        """ Fire the recalculation of the component solution from thread. """
        def __expire_component_solution():
            ghenv.Component.Params.Output[0].ClearData()  # clear the output
            ghenv.Component.ExpireSolution(True)  # expire the component
        action = System.Action(__expire_component_solution)
        Rhino.RhinoApp.InvokeOnUiThread(action)

    def clear_component(self):
        """ Clear the component from thread. """
        def __clear_component():
            ghenv.Component.ClearData()
        action = System.Action(__clear_component)
        Rhino.RhinoApp.InvokeOnUiThread(action)

    def add_runtime_warning(self, exception : str):
        """ Add a warning tab to the component from main thread. """
        action = System.Action(
            lambda: ghenv.Component.AddRuntimeMessage(RML.Warning, exception)
        )
        Rhino.RhinoApp.InvokeOnUiThread(action)

    def add_runtime_error(self, exception : str):
        """ Add an error tab to the component from main thread. """
        action = System.Action(
            lambda: ghenv.Component.AddRuntimeMessage(RML.Error, exception)
        )
        Rhino.RhinoApp.InvokeOnUiThread(action)

    def add_runtime_remark(self, exception : str):
        """ Add a blank tab to the component from main thread. """
        action = System.Action(
            lambda: ghenv.Component.AddRuntimeMessage(RML.Remark, exception)
        )
        Rhino.RhinoApp.InvokeOnUiThread(action)

    @property
    def component_enabled(self):
        self._check_if_component_enabled()
        return self._component_enabled

    @property
    def component_on_canvas(self):
        self._check_if_component_on_canvas()
        return self._component_on_canvas

class ClientThread(GHThread):
    """
    A thread to connect to the VSCode server.
    """
    def __init__(self, vscode_server_ip: str, vscode_server_port: int, name: str,
                 queue_msg: queue.Queue = None, lock_queue_msg: threading.Lock = None,
                 event_fire_msg: threading.Event = None):
        super().__init__(name=name)
        self.vscode_server_ip = vscode_server_ip
        self.vscode_server_port = vscode_server_port
        self.is_connected = False
        self.connect_refresh_rate = 1  # seconds
        self.queue_msg = queue_msg
        self.lock_queue_msg = lock_queue_msg
        self.event_fire_msg = event_fire_msg
        self.client_socket = socket.socket(socket.AF_INET, socket.SOCK_STREAM)

    def run(self):
        """ Run the thread. Send the message to the vscode server."""
        while self.component_on_canvas and self.component_enabled:
            try:
                if not self.is_connected:
                    self.connect_to_vscode_server()
                    self.clear_component()
                    self.expire_component_solution()
                    continue

                self.event_fire_msg.wait()
                self.send_message_from_queue()

            except Exception as e:
                self.add_runtime_warning(f"script-sync::Unkown error from run: {str(e)}")
                self.is_connected = False
                self.client_socket = socket.socket(socket.AF_INET, socket.SOCK_STREAM)

        self.client_socket.close()

    def send_message_from_queue(self):
        with self.lock_queue_msg:
            if self.queue_msg and not self.queue_msg.empty():
                msg = self.queue_msg.get()
                self.queue_msg.task_done()
                self.event_fire_msg.set()
                self.event_fire_msg.clear()
                self.client_socket.send(msg)

    def connect_to_vscode_server(self):
        """ Connect to the VSCode server. """
        while self.component_on_canvas and not self.is_connected:
            try:
                self.client_socket.send(b"")
                self.is_connected = True
            except socket.error:
                try:
                    self.client_socket.connect((self.vscode_server_ip, self.vscode_server_port))
                    self.is_connected = True
                except (ConnectionRefusedError, ConnectionResetError, socket.error) as e:
                    self.handle_connection_error(e)
            finally:
                time.sleep(self.connect_refresh_rate)

    def handle_connection_error(self, e):
        error_messages = {
            ConnectionRefusedError: "script-sync::Connection refused by the vscode",
            ConnectionResetError: "script-sync::Connection was forcibly closed by the vscode",
            socket.error: f"script-sync::Error connecting to the vscode: {str(e)}, have you tried to press Shift+F4 on VSCode?"
        }
        self.add_runtime_warning(error_messages[type(e)])
        self.is_connected = False if type(e) != socket.error or e.winerror != 10056 else True

class FileChangedThread(GHThread):
    """
        A thread to check if the file has changed on disk.
    """
    def __init__(self,
                path : str,
                name : str
                ):
        super().__init__(name=name)
        self.path = path
        self.refresh_rate = 1000  # milliseconds
        self._on_file_changed = threading.Event()

    def run(self):
        """
            Check if the file has changed on disk.
        """
        last_modified = os.path.getmtime(self.path)
        while self.component_on_canvas and not self._on_file_changed.is_set():
            System.Threading.Thread.Sleep(self.refresh_rate)
            last_modified = self.is_file_modified(last_modified)
        self._on_file_changed.clear()
        return

    def stop(self):
        """ Stop the thread. """
        self._on_file_changed.set()

    def is_file_modified(self, last_modified):
        current_modified = os.path.getmtime(self.path)
        if current_modified != last_modified:
            self.expire_component_solution()
            return current_modified
        return last_modified

class ScriptSyncCPy(component):
    def __init__(self):
        super(ScriptSyncCPy, self).__init__()
        self._var_output = []

        self.is_success = False

        self.client_thread_name : str = f"script-sync-client-thread::{ghenv.Component.InstanceGuid}"
        self.vscode_server_ip = "127.0.0.1"
        self.vscode_server_port = 58260
        self.stdout = None
        self.queue_msg = queue.Queue()
        self.queue_msg_lock = threading.Lock()
        self.event_fire_msg = threading.Event()

        self.filechanged_thread_name : str = f"script-sync-fileChanged-thread::{ghenv.Component.InstanceGuid}"
        self.__path_name_table_value = "script-sync::" + "path::" + str(ghenv.Component.InstanceGuid)
        if self.path is None:
            ghenv.Component.Message = "select-script"

    def RemovedFromDocument(self, doc):
        """ Remove the component from the document. """
        if self.client_thread_name in [t.name for t in threading.enumerate()]:
            client_thread = [t for t in threading.enumerate() if t.name == self.client_thread_name][0]
            client_thread.join()
        if self.filechanged_thread_name in [t.name for t in threading.enumerate()]:
            filechanged_thread = [t for t in threading.enumerate() if t.name == self.filechanged_thread_name][0]
            filechanged_thread.join()
        if self.queue_msg is not None:
            self.queue_msg.join()
        if self.queue_msg_lock is not None:
            self.queue_msg_lock.release()
        if self.event_fire_msg is not None:
            self.event_fire_msg.clear()

        # clear the path from the table view
        del self.path

    def init_script_path(self, select_file : bool = False):
        """
            Check if the button is pressed and load/change path script.
            
            :param select_file: A boolean of the button
        """
        # check if button is pressed
        if select_file is True:
            filename = rs.OpenFileName("Open", "Python Files (*.py)|*.py||")
            if filename is None:
                raise Exception("script-sync::No file selected")
            self.path = filename

        # fi file is in table view before
        if not os.path.exists(self.path):
            raise Exception("script-sync::File does not exist")
    
    def reload_all_modules(self, directory):
        for filename in os.listdir(directory):
            if filename.endswith('.py') and filename != '__init__.py':
                module_name = filename[:-3]  # remove '.py' from filename
                if module_name in sys.modules:
                    importlib.reload(sys.modules[module_name])

    def safe_exec(self, path, globals, locals, packages_2_reload):
        """
            Execute Python3 code safely. It redirects the output of the code
            to a string buffer 'stdout' to output to the GH component param.
            It is send to the vscode server.
            
            :param path: The path of the file to execute.
            :param globals: The globals dictionary.
            :param locals: The locals dictionary.
            :param packages_2_reload: The list of packages to reload, this is used for custom packages developement.
            installed on the system via an editable pip installation for example.
        """
        try:
            with open(path, 'r') as f:
                # reload the specifyed packages
                if packages_2_reload is not None:
                    if packages_2_reload.__len__() != 0:
                        for package in packages_2_reload:
                            for key in list(sys.modules.keys()):
                                if package in key:
                                    #check that the package must have the attribute __file__ (to avoid reloading pyd)
                                    if hasattr(sys.modules[key], '__file__'):
                                        importlib.reload(sys.modules[key])

                # add the path and sub directories to  the sys path
                path_dir = os.path.dirname(path)
                sub_dirs = []
                for root, dirs, files in os.walk(path_dir):
                    for d in dirs:
                        sub_dirs.append(os.path.join(root, d))
                sys.path.extend([path_dir] + sub_dirs)

                # reload all the modules also of the sub directories
                for root, dirs, files in os.walk(path_dir):
                    for d in dirs:
                        self.reload_all_modules(os.path.join(root, d))
                self.reload_all_modules(path_dir)

                # refresh the python interpreter
                importlib.invalidate_caches()

                # parse the code
                code = compile(f.read(), path, 'exec')
                output = io.StringIO()

                # empty the queue and event
                with self.queue_msg_lock:
                    while not self.queue_msg.empty():
                        self.queue_msg.get()
                        self.queue_msg.task_done()
                self.event_fire_msg.clear()

                # clear all the locals dictionary to avoid that the output variables stick between the component
                # executions when it is recomputed
                outparam = ghenv.Component.Params.Output
                outparam_names = [p.NickName for p in outparam]
                for outp in outparam_names:
                    if outp in locals.keys():
                        del locals[outp]

                # execute the code
                with contextlib.redirect_stdout(output):
                    exec(code, globals, locals)
                locals["stdout"] = output.getvalue()

                # send the msg to the vscode server
                msg_json = json.dumps({"script_path": path,
                                       "guid": str(ghenv.Component.InstanceGuid),
                                       "msg": output.getvalue()})
                msg_json = msg_json.encode('utf-8')
                self.queue_msg.put(msg_json)
                self.event_fire_msg.set()

                # pass the script variables to the GH component outputs
                for outp in outparam_names:
                    if outp in locals.keys():
                        self._var_output.append(locals[outp])
                    else:
                        self._var_output.append(None)

                sys.stdout = sys.__stdout__
            return locals

        except Exception as e:
            # Get the traceback
            tb = traceback.format_exc()

            # Send the error message to the vscode server
            err_json = json.dumps({
                "script_path": path,
                "guid": str(ghenv.Component.InstanceGuid),
                "msg": "err:" + str(e),
                "traceback": tb  # Include the traceback in the JSON
            })
            err_json = err_json.encode('utf-8')
            self.queue_msg.put(err_json)
            self.event_fire_msg.set()

            sys.stdout = sys.__stdout__

            err_msg = f"script-sync::Error in the code: {str(e)}\n{tb}"
            raise Exception(err_msg)

    def RunScript(self,
        select_file: bool,
        packages_2_reload : list,
        i_results,
        i_viz_settings
    ):
        """ This method is called whenever the component has to be recalculated it's the solve main instance. """
        self.is_success = False

        # set the path if button is pressed
        self.init_script_path(select_file)

        # file change listener thread
        if self.filechanged_thread_name not in [t.name for t in threading.enumerate()]:
            FileChangedThread(self.path,
                              self.filechanged_thread_name
                              ).start()

        # set up the tcp client to connect to the vscode server
        _ = [print(t.name) for t in threading.enumerate()]
        if self.client_thread_name not in [t.name for t in threading.enumerate()]:
            ClientThread(self.vscode_server_ip,
                        self.vscode_server_port,
                        self.client_thread_name,
                        self.queue_msg,
                        self.queue_msg_lock,
                        self.event_fire_msg
                        ).start()

        # add to the globals all the input parameters of the component (the locals)
        globals().update(locals())

        res = self.safe_exec(self.path, None, globals(), packages_2_reload)
        self.is_success = True
        return

    def is_nested_iterable(self, lst):
        """ Detect if a list is nested. """
        return any(isinstance(i, list) for i in lst)

    def AfterRunScript(self):
        """
            This method is called as soon as the component has finished
            its calculation. It is used to load the GHComponent outputs
            with the values created in the script.
        """
        if not self.is_success:
            return

        outparam = [p for p in ghenv.Component.Params.Output]
        outparam_names = [p.NickName for p in outparam]

        for idx, outp in enumerate(outparam):
            # detect if the output is a list
            if type(self._var_output[idx]) == tuple:
                ghenv.Component.Params.Output[idx].VolatileData.Clear()
                ghenv.Component.Params.Output[idx].AddVolatileDataList(gh.Kernel.Data.GH_Path(0), self._var_output[idx])
            # TODO: increase the number of nested lists they can be handles (max 2 deep for now)
            elif type(self._var_output[idx]) == list:
                ghenv.Component.Params.Output[idx].VolatileData.Clear()
                if self.is_nested_iterable(self._var_output[idx]):
                    nbr_lists_aka_branches = len(self._var_output[idx])
                    for i in range(nbr_lists_aka_branches):
                        ghenv.Component.Params.Output[idx].AddVolatileDataList(gh.Kernel.Data.GH_Path(i), self._var_output[idx][i])
                else:
                    ghenv.Component.Params.Output[idx].AddVolatileDataList(gh.Kernel.Data.GH_Path(0), self._var_output[idx])
            else:
                ghenv.Component.Params.Output[idx].VolatileData.Clear()
                ghenv.Component.Params.Output[idx].AddVolatileData(gh.Kernel.Data.GH_Path(0), 0, self._var_output[idx])
        self._var_output.clear()

    @property
    def path(self):
        """ Get the path of the file from the table view to be sticking between the sessions. """
        table_value = ghenv.Component.OnPingDocument().ValueTable.GetValue(
            self.__path_name_table_value, "not_found"
        )
        if table_value != "not_found":
            return table_value
        else:
            return None

    @path.setter
    def path(self, path : str):
        """ Set the path of the file to the table view to be sticking between the sessions. """
        ghenv.Component.OnPingDocument().ValueTable.SetValue(self.__path_name_table_value, path)

        script_name = os.path.basename(path)
        ghenv.Component.Message = f"{script_name}"

        if self.filechanged_thread_name in [t.name for t in threading.enumerate()]:
            _ = [t for t in threading.enumerate() if t.name == self.filechanged_thread_name][0].stop()

    @path.deleter
    def path(self):
        """ Delete the path of the file from the table view if the object is erased. """
        ghenv.Component.OnPingDocument().ValueTable.DeleteValue(self.__path_name_table_value)
# ---------- end vizualization ----------
cvs_export = ScriptSyncCpython(select_file=Button(), packages_2_reload="diffCheck", i_dump=Toggle(True), i_export_dir=file_path)  # -> stdout; inputs select_file: Boolean, packages_2_reload: list of String, i_export_dir: String
#   port select_file: Connect a button to open a file dialog to select a cpython file to run.
#   port packages_2_reload: Pass a list with the name of the custom packages you want to reload. This function is useful if you are developing a i.e. PyPI package and you want to reload the submodules after you modified something. The function will reload the package and all its submodules. If you want to reload the package and all its submodules, just pass the package name. If you want to reload only a submodule, pass the package name and the submodule name separated by a dot. If you want to reload multiple submodules, pass the package
#   port stdout: The redirected standard output of the component scriptsync.
# ---------- cvs_export: Python ----------
from ghpythonlib.componentbase import executingcomponent as component

import System
import System.Drawing
import Rhino
import rhinoscriptsyntax as rs
import Grasshopper
import Grasshopper as gh
from Grasshopper.Kernel import GH_RuntimeMessageLevel as RML
import sys
import os
import time

import contextlib
import io

import abc
import socket
import threading
import queue
import json

import importlib
import sys

import traceback


class GHThread(threading.Thread, metaclass=abc.ABCMeta):
    """
        A base class for Grasshopper threads.
    """
    def __init__(self, name : str):
        super().__init__(name=name, daemon=False)
        self._component_on_canvas = True
        self._component_enabled = True

    @abc.abstractmethod
    def run(self):
        """ Run the thread. """
        pass

    def _check_if_component_on_canvas(self):
        """ Check if the component is on canvas from thread. """
        def __check_if_component_on_canvas():
            if ghenv.Component.OnPingDocument() is None:
                self._component_on_canvas = False
                return False
            else:
                self._component_on_canvas = True
                return True
        action = System.Action(__check_if_component_on_canvas)
        Rhino.RhinoApp.InvokeOnUiThread(action)

    def _check_if_component_enabled(self):
        """ Check if the component is enabled from thread. """
        def __check_if_component_enabled():
            if ghenv.Component.Locked:
                self._component_enabled = False
            else:
                self._component_enabled = True
        action = System.Action(__check_if_component_enabled)
        Rhino.RhinoApp.InvokeOnUiThread(action)

    def expire_component_solution(self):
        """ Fire the recalculation of the component solution from thread. """
        def __expire_component_solution():
            ghenv.Component.Params.Output[0].ClearData()  # clear the output
            ghenv.Component.ExpireSolution(True)  # expire the component
        action = System.Action(__expire_component_solution)
        Rhino.RhinoApp.InvokeOnUiThread(action)

    def clear_component(self):
        """ Clear the component from thread. """
        def __clear_component():
            ghenv.Component.ClearData()
        action = System.Action(__clear_component)
        Rhino.RhinoApp.InvokeOnUiThread(action)

    def add_runtime_warning(self, exception : str):
        """ Add a warning tab to the component from main thread. """
        action = System.Action(
            lambda: ghenv.Component.AddRuntimeMessage(RML.Warning, exception)
        )
        Rhino.RhinoApp.InvokeOnUiThread(action)

    def add_runtime_error(self, exception : str):
        """ Add an error tab to the component from main thread. """
        action = System.Action(
            lambda: ghenv.Component.AddRuntimeMessage(RML.Error, exception)
        )
        Rhino.RhinoApp.InvokeOnUiThread(action)

    def add_runtime_remark(self, exception : str):
        """ Add a blank tab to the component from main thread. """
        action = System.Action(
            lambda: ghenv.Component.AddRuntimeMessage(RML.Remark, exception)
        )
        Rhino.RhinoApp.InvokeOnUiThread(action)

    @property
    def component_enabled(self):
        self._check_if_component_enabled()
        return self._component_enabled

    @property
    def component_on_canvas(self):
        self._check_if_component_on_canvas()
        return self._component_on_canvas

class ClientThread(GHThread):
    """
    A thread to connect to the VSCode server.
    """
    def __init__(self, vscode_server_ip: str, vscode_server_port: int, name: str,
                 queue_msg: queue.Queue = None, lock_queue_msg: threading.Lock = None,
                 event_fire_msg: threading.Event = None):
        super().__init__(name=name)
        self.vscode_server_ip = vscode_server_ip
        self.vscode_server_port = vscode_server_port
        self.is_connected = False
        self.connect_refresh_rate = 1  # seconds
        self.queue_msg = queue_msg
        self.lock_queue_msg = lock_queue_msg
        self.event_fire_msg = event_fire_msg
        self.client_socket = socket.socket(socket.AF_INET, socket.SOCK_STREAM)

    def run(self):
        """ Run the thread. Send the message to the vscode server."""
        while self.component_on_canvas and self.component_enabled:
            try:
                if not self.is_connected:
                    self.connect_to_vscode_server()
                    self.clear_component()
                    self.expire_component_solution()
                    continue

                self.event_fire_msg.wait()
                self.send_message_from_queue()

            except Exception as e:
                self.add_runtime_warning(f"script-sync::Unkown error from run: {str(e)}")
                self.is_connected = False
                self.client_socket = socket.socket(socket.AF_INET, socket.SOCK_STREAM)

        self.client_socket.close()

    def send_message_from_queue(self):
        with self.lock_queue_msg:
            if self.queue_msg and not self.queue_msg.empty():
                msg = self.queue_msg.get()
                self.queue_msg.task_done()
                self.event_fire_msg.set()
                self.event_fire_msg.clear()
                self.client_socket.send(msg)

    def connect_to_vscode_server(self):
        """ Connect to the VSCode server. """
        while self.component_on_canvas and not self.is_connected:
            try:
                self.client_socket.send(b"")
                self.is_connected = True
            except socket.error:
                try:
                    self.client_socket.connect((self.vscode_server_ip, self.vscode_server_port))
                    self.is_connected = True
                except (ConnectionRefusedError, ConnectionResetError, socket.error) as e:
                    self.handle_connection_error(e)
            finally:
                time.sleep(self.connect_refresh_rate)

    def handle_connection_error(self, e):
        error_messages = {
            ConnectionRefusedError: "script-sync::Connection refused by the vscode",
            ConnectionResetError: "script-sync::Connection was forcibly closed by the vscode",
            socket.error: f"script-sync::Error connecting to the vscode: {str(e)}, have you tried to press Shift+F4 on VSCode?"
        }
        self.add_runtime_warning(error_messages[type(e)])
        self.is_connected = False if type(e) != socket.error or e.winerror != 10056 else True

class FileChangedThread(GHThread):
    """
        A thread to check if the file has changed on disk.
    """
    def __init__(self,
                path : str,
                name : str
                ):
        super().__init__(name=name)
        self.path = path
        self.refresh_rate = 1000  # milliseconds
        self._on_file_changed = threading.Event()

    def run(self):
        """
            Check if the file has changed on disk.
        """
        last_modified = os.path.getmtime(self.path)
        while self.component_on_canvas and not self._on_file_changed.is_set():
            System.Threading.Thread.Sleep(self.refresh_rate)
            last_modified = self.is_file_modified(last_modified)
        self._on_file_changed.clear()
        return

    def stop(self):
        """ Stop the thread. """
        self._on_file_changed.set()

    def is_file_modified(self, last_modified):
        current_modified = os.path.getmtime(self.path)
        if current_modified != last_modified:
            self.expire_component_solution()
            return current_modified
        return last_modified

class ScriptSyncCPy(component):
    def __init__(self):
        super(ScriptSyncCPy, self).__init__()
        self._var_output = []

        self.is_success = False

        self.client_thread_name : str = f"script-sync-client-thread::{ghenv.Component.InstanceGuid}"
        self.vscode_server_ip = "127.0.0.1"
        self.vscode_server_port = 58260
        self.stdout = None
        self.queue_msg = queue.Queue()
        self.queue_msg_lock = threading.Lock()
        self.event_fire_msg = threading.Event()

        self.filechanged_thread_name : str = f"script-sync-fileChanged-thread::{ghenv.Component.InstanceGuid}"
        self.__path_name_table_value = "script-sync::" + "path::" + str(ghenv.Component.InstanceGuid)
        if self.path is None:
            ghenv.Component.Message = "select-script"

    def RemovedFromDocument(self, doc):
        """ Remove the component from the document. """
        if self.client_thread_name in [t.name for t in threading.enumerate()]:
            client_thread = [t for t in threading.enumerate() if t.name == self.client_thread_name][0]
            client_thread.join()
        if self.filechanged_thread_name in [t.name for t in threading.enumerate()]:
            filechanged_thread = [t for t in threading.enumerate() if t.name == self.filechanged_thread_name][0]
            filechanged_thread.join()
        if self.queue_msg is not None:
            self.queue_msg.join()
        if self.queue_msg_lock is not None:
            self.queue_msg_lock.release()
        if self.event_fire_msg is not None:
            self.event_fire_msg.clear()

        # clear the path from the table view
        del self.path

    def init_script_path(self, select_file : bool = False):
        """
            Check if the button is pressed and load/change path script.
            
            :param select_file: A boolean of the button
        """
        # check if button is pressed
        if select_file is True:
            filename = rs.OpenFileName("Open", "Python Files (*.py)|*.py||")
            if filename is None:
                raise Exception("script-sync::No file selected")
            self.path = filename

        # fi file is in table view before
        if not os.path.exists(self.path):
            raise Exception("script-sync::File does not exist")
    
    def reload_all_modules(self, directory):
        for filename in os.listdir(directory):
            if filename.endswith('.py') and filename != '__init__.py':
                module_name = filename[:-3]  # remove '.py' from filename
                if module_name in sys.modules:
                    importlib.reload(sys.modules[module_name])

    def safe_exec(self, path, globals, locals, packages_2_reload):
        """
            Execute Python3 code safely. It redirects the output of the code
            to a string buffer 'stdout' to output to the GH component param.
            It is send to the vscode server.
            
            :param path: The path of the file to execute.
            :param globals: The globals dictionary.
            :param locals: The locals dictionary.
            :param packages_2_reload: The list of packages to reload, this is used for custom packages developement.
            installed on the system via an editable pip installation for example.
        """
        try:
            with open(path, 'r') as f:
                # reload the specifyed packages
                if packages_2_reload is not None:
                    if packages_2_reload.__len__() != 0:
                        for package in packages_2_reload:
                            for key in list(sys.modules.keys()):
                                if package in key:
                                    #check that the package must have the attribute __file__ (to avoid reloading pyd)
                                    if hasattr(sys.modules[key], '__file__'):
                                        importlib.reload(sys.modules[key])

                # add the path and sub directories to  the sys path
                path_dir = os.path.dirname(path)
                sub_dirs = []
                for root, dirs, files in os.walk(path_dir):
                    for d in dirs:
                        sub_dirs.append(os.path.join(root, d))
                sys.path.extend([path_dir] + sub_dirs)

                # reload all the modules also of the sub directories
                for root, dirs, files in os.walk(path_dir):
                    for d in dirs:
                        self.reload_all_modules(os.path.join(root, d))
                self.reload_all_modules(path_dir)

                # refresh the python interpreter
                importlib.invalidate_caches()

                # parse the code
                code = compile(f.read(), path, 'exec')
                output = io.StringIO()

                # empty the queue and event
                with self.queue_msg_lock:
                    while not self.queue_msg.empty():
                        self.queue_msg.get()
                        self.queue_msg.task_done()
                self.event_fire_msg.clear()

                # clear all the locals dictionary to avoid that the output variables stick between the component
                # executions when it is recomputed
                outparam = ghenv.Component.Params.Output
                outparam_names = [p.NickName for p in outparam]
                for outp in outparam_names:
                    if outp in locals.keys():
                        del locals[outp]

                # execute the code
                with contextlib.redirect_stdout(output):
                    exec(code, globals, locals)
                locals["stdout"] = output.getvalue()

                # send the msg to the vscode server
                msg_json = json.dumps({"script_path": path,
                                       "guid": str(ghenv.Component.InstanceGuid),
                                       "msg": output.getvalue()})
                msg_json = msg_json.encode('utf-8')
                self.queue_msg.put(msg_json)
                self.event_fire_msg.set()

                # pass the script variables to the GH component outputs
                for outp in outparam_names:
                    if outp in locals.keys():
                        self._var_output.append(locals[outp])
                    else:
                        self._var_output.append(None)

                sys.stdout = sys.__stdout__
            return locals

        except Exception as e:
            # Get the traceback
            tb = traceback.format_exc()

            # Send the error message to the vscode server
            err_json = json.dumps({
                "script_path": path,
                "guid": str(ghenv.Component.InstanceGuid),
                "msg": "err:" + str(e),
                "traceback": tb  # Include the traceback in the JSON
            })
            err_json = err_json.encode('utf-8')
            self.queue_msg.put(err_json)
            self.event_fire_msg.set()

            sys.stdout = sys.__stdout__

            err_msg = f"script-sync::Error in the code: {str(e)}\n{tb}"
            raise Exception(err_msg)

    def RunScript(self,
        select_file: bool,
        packages_2_reload : list,
        i_dump,
        i_export_dir: bool,
        i_results
    ):
        """ This method is called whenever the component has to be recalculated it's the solve main instance. """
        self.is_success = False

        # set the path if button is pressed
        self.init_script_path(select_file)

        # file change listener thread
        if self.filechanged_thread_name not in [t.name for t in threading.enumerate()]:
            FileChangedThread(self.path,
                              self.filechanged_thread_name
                              ).start()

        # set up the tcp client to connect to the vscode server
        _ = [print(t.name) for t in threading.enumerate()]
        if self.client_thread_name not in [t.name for t in threading.enumerate()]:
            ClientThread(self.vscode_server_ip,
                        self.vscode_server_port,
                        self.client_thread_name,
                        self.queue_msg,
                        self.queue_msg_lock,
                        self.event_fire_msg
                        ).start()

        # add to the globals all the input parameters of the component (the locals)
        globals().update(locals())

        res = self.safe_exec(self.path, None, globals(), packages_2_reload)
        self.is_success = True
        return

    def is_nested_iterable(self, lst):
        """ Detect if a list is nested. """
        return any(isinstance(i, list) for i in lst)

    def AfterRunScript(self):
        """
            This method is called as soon as the component has finished
            its calculation. It is used to load the GHComponent outputs
            with the values created in the script.
        """
        if not self.is_success:
            return

        outparam = [p for p in ghenv.Component.Params.Output]
        outparam_names = [p.NickName for p in outparam]

        for idx, outp in enumerate(outparam):
            # detect if the output is a list
            if type(self._var_output[idx]) == tuple:
                ghenv.Component.Params.Output[idx].VolatileData.Clear()
                ghenv.Component.Params.Output[idx].AddVolatileDataList(gh.Kernel.Data.GH_Path(0), self._var_output[idx])
            # TODO: increase the number of nested lists they can be handles (max 2 deep for now)
            elif type(self._var_output[idx]) == list:
                ghenv.Component.Params.Output[idx].VolatileData.Clear()
                if self.is_nested_iterable(self._var_output[idx]):
                    nbr_lists_aka_branches = len(self._var_output[idx])
                    for i in range(nbr_lists_aka_branches):
                        ghenv.Component.Params.Output[idx].AddVolatileDataList(gh.Kernel.Data.GH_Path(i), self._var_output[idx][i])
                else:
                    ghenv.Component.Params.Output[idx].AddVolatileDataList(gh.Kernel.Data.GH_Path(0), self._var_output[idx])
            else:
                ghenv.Component.Params.Output[idx].VolatileData.Clear()
                ghenv.Component.Params.Output[idx].AddVolatileData(gh.Kernel.Data.GH_Path(0), 0, self._var_output[idx])
        self._var_output.clear()

    @property
    def path(self):
        """ Get the path of the file from the table view to be sticking between the sessions. """
        table_value = ghenv.Component.OnPingDocument().ValueTable.GetValue(
            self.__path_name_table_value, "not_found"
        )
        if table_value != "not_found":
            return table_value
        else:
            return None

    @path.setter
    def path(self, path : str):
        """ Set the path of the file to the table view to be sticking between the sessions. """
        ghenv.Component.OnPingDocument().ValueTable.SetValue(self.__path_name_table_value, path)

        script_name = os.path.basename(path)
        ghenv.Component.Message = f"{script_name}"

        if self.filechanged_thread_name in [t.name for t in threading.enumerate()]:
            _ = [t for t in threading.enumerate() if t.name == self.filechanged_thread_name][0].stop()

    @path.deleter
    def path(self):
        """ Delete the path of the file from the table view if the object is erased. """
        ghenv.Component.OnPingDocument().ValueTable.DeleteValue(self.__path_name_table_value)
# ---------- end cvs_export ----------
data = Data()
vizualization_2 = ScriptSyncCpython(select_file=Button(), packages_2_reload="diffCheck", i_viz_settings=viz_settings.o_viz_settings)  # -> stdout, o_colored_geo, o_legend, o_histogram; inputs select_file: Boolean, packages_2_reload: list of String; same code as vizualization
sort_list = SortList(Keys=data)  # -> Keys, ValuesValuesA
panel_5 = Panel(cvs_export)
bar_graph = BarGraph(data, BarColor=RGB(255, 0, 90))
list_item_3 = ListItem(List=sort_list.Keys, Index=0, Wrap=True)  # -> Item1, Item
panel_6 = Panel(vizualization_2.stdout)
point_cloud_3 = PointCloud(vizualization.o_colored_geo)
geometry = Geometry(vizualization.o_histogram)
geometry_2 = Geometry(vizualization.o_legend)
unit_x_2 = UnitX(Factor=Slider(8, range=0..100))
point_cloud_4 = PointCloud(vizualization_2.o_colored_geo)
geometry_3 = Geometry(vizualization_2.o_histogram)
geometry_4 = Geometry(vizualization_2.o_legend)
panel_7 = Panel(list_item_3.Item)
panel_8 = Panel(list_item_3.Item1)
move_5 = Move(Geometry=[geometry_3, geometry_4], Motion=unit_x_2)  # -> Geometry, Transform
unit_x_3 = UnitX(Factor=Slider(9, range=0..10))
move_6 = Move(Geometry=[tree_branch, tree_branch_2], Motion=unit_x_3)  # -> Geometry, Transform
move_7 = Move(Geometry=vizualization_2.o_colored_geo, Motion=unit_x_3)  # -> Geometry, Transform
